# Grasshopper definition Self-supportPrintingSimualtion.gh (Grasshopper 1.0.7)
# plug-ins: Karamba3D, Human, Firefly.Core, Pufferfish, Machina, KUKA|prc - parametric robot control, TT Toolbox

# ---- group: GeometryShape
geometrypattern = Curve(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)
scale_of_shape = Slider(-0.4, range=-1..1)
curvature_axis = Curve(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)
position_of_curvatureaxis = Point(Point(1024.743775, 284.241225, 796.5848453))

# ---- group: Material Properties
# Process simulation for Self-support printability of 3D Curvature-orient printing clay form with an Additional-axis base
# (1) Optimize the shape of the printed object according to the Self-support printability.
# (2) Predict the form limitations of printing process.
# (3) Optimize printing actions through predictions to improve the accuracy of global form.
# Self-support printing
# Author: Xuanyu lu
# Input Parameters
number_slider = Slider(13.865, range=0..100)
curingspeed_mm_s = Slider(5, range=0..10)
curingparameters = Slider(0.0056, range=0..0.01)
number_slider_2 = Slider(5.6, range=0..10)

# ---- group: RoboticActions
machinasend = Button()
sendrotationbaseactions = Button()
# Printing Action Sending
kuka_simulation_slider = Slider(1, range=0..1)
printingheadtcp = Point(Point(1024.743775, 129.9026654, 643.4956261))
finalactionspt = Point(Point(896.2758464, 320.0525869, 1113.437761))

# ---- group: KUKA Prc simulation / printing head(tool)
geo = Geometry([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])
rotate = Rotate(Geometry=geo, Angle=1.570796327, Plane=PlaneXY(0, 0, 0))  # -> Geometry, Transform
mesh = MeshBrep(
    Brep=rotate.Geometry,
    Settings={GridMaxCount=0, GridMinCount=16, JaggedSeams=False, MaxEdgeLength=0, MinEdgeLength=0.0001, MinTolerance=0, Refine=True, RefineAngle=0, RelativeTolerance=0.65, SimplePlanes=True, Tolerance=0})
mjoin = MeshJoin(Meshes=mesh)
custom_tool = CustomToolKUKAPrc(
    CustomToolGeometry=mjoin,
    toolid=7,
    toolvala=0,
    toolvalb=0,
    toolvalc=0,
    toolvalx=137.82233,
    toolvaly=-44.322331,
    toolvalz=28.5,
    valuesset=True)

# ----
tcpdis_mm = Slider(3, range=0..10)

# ---- group: cheakingTcp
transformto = TransformTo(Plane=printingheadtcp, Relative=False)

# ---- group: toolSetting
xy = XYPlane(Origin=Point(0, 0, 0))
height_of_nozzle7mm = Panel("28")
deplane = DeconstructPlane(Plane=xy)  # -> Origin, XAxis, YAxis, ZAxis
pdecon = Deconstruct(Point=deplane.Origin)  # -> XComponent, YComponent, ZComponent
addition = Addition(A=pdecon.XComponent, B=height_of_nozzle7mm)
pt = ConstructPoint(
    XCoordinate=expr("x+109.82233", addition),
    YCoordinate=expr("x-44.32233", pdecon.YComponent),
    ZCoordinate=expr("x+28.5", pdecon.ZComponent))
xy_2 = XYPlane(Origin=pt)

# ---- group: Machina Bridge / toolSetting
xy_3 = XYPlane(Origin=Point(0, 0, 0))
# Robotic Action controller (Machina)
panel = Panel("printHead")
tcpplane = Plane(xy_2)
definetool = DefineTool(Name=panel, BasePlane=xy_3, TCPPlane=tcpplane, Weight=0.1)
attachtool = AttachTool(ToolName=panel)

# ----
# Self-support function for Slipping off from the base
nozzlesize_mm = Slider(6, range=0..10)

# ---- group: Inclination calculation(atmospheric pressure force) / ExtrusionWeight
panel_2 = Panel("0.35")

# ---- group: PathHeight&RoboticArmSpeed
panel_3 = Panel("1.5 to 6.0")
panel_4 = Panel("40 to 20")

# ---- group: Define Loads
loads = LoadsKaramba3D(Vector=Vector(0, 0, -1), LCase=Slider(0, range=0..1), mode="Gravity")

# ---- group: Define Cross Sections
pt_2 = ConstructPoint(XCoordinate="1E10", YCoordinate="1E10", ZCoordinate="1E10")
pt_3 = ConstructPoint(XCoordinate="1E-6", YCoordinate="1E-6", ZCoordinate="1E-6")
panel_5 = Panel("Spring")
cross_section = CrossSectionKaramba3D(
    FamilyNameOfCrossSection="DefaultCroSec",
    ElementIdentifier=panel_5,
    CTranslation_kN_m=pt_2,
    CRotation_kNm_rad=pt_3,
    mode="Spring")

# ---- group: PathSetting
fealayersperloop = Slider(4, range=0..10)
printwidth_cm = Slider(0.7, range=0..25)
newpathstartindex = Slider(4, range=0..100)
printendindex = Slider(8, range=1..100)
printstartindex = Slider(4, range=0..100)
rotationdegreea = Slider(30, range=0..100)
rotationdegreeb = Slider(0, range=-90..90)

# ----
neg = Negative(Value=rotationdegreea)

# ---- group: Rotating Base Arduino
addition_2 = Addition(A=rotationdegreeb, B=90)
trigger = Trigger(Interval=100, TimerInterval=100, Target=c_script)  # disabled
# Additional-axis base controller (FireFly)
toggle = BooleanToggle(False)
addition_3 = Addition(A=neg, B=90)
c_script = CSharpScript(send=sendrotationbaseactions, d1=addition_3, d2=addition_2)  # -> out, A, B; inputs send: Boolean, reset: Boolean, d1: Int32, d2: Int32
# ---------- c_script: C# ----------
    if(reset)
    {
      preV1 = 90;
      preV2 = 90;
    }

    if (send == true)
    {
      change = true;
    }

    if( change == true)
    {
      curV1 = d1;
      curV2 = d2;
      int interV1 = curV1 - preV1;
      int interV2 = curV2 - preV2;

      if(interV1 > 0)
      {
        preV1 += 1;
        if(preV1 == curV1)
        {
          preV1 = d1;

        }
      }

      else if(interV1 < 0)
      {
        preV1 -= 1;
        if(preV1 == curV1)
        {
          preV1 = d1;

        }
      }

      else if(interV1 == 0)
      {
        preV1 = d1;

      }

      ///
      if(interV2 > 0)
      {
        preV2 += 1;
        if(preV2 == curV2)
        {
          preV2 = d2;

        }
      }

      else if(interV2 < 0)
      {
        preV2 -= 1;
        if(preV2 == curV2)
        {
          preV2 = d2;

        }
      }

      else if(interV2 == 0)
      {
        preV2 = d2;

      }

      if (preV1 == d1 && preV2 == d2)
      {
        change = false;
      }


    }

    A = preV1;
    B = preV2;
# ---------- c_script: C# additional code ----------
  int preV1 = 90;
  int curV1;
  int preV2 = 90;
  int curV2;
  bool change = false;
# ---------- end c_script ----------
open_port = OpenClosePort(OpenClosePort=toggle, PortNumber="9", BaudRate=115200)
panel_6 = Panel([c_script.A, c_script.out, c_script.B])
uno_write = UnoWrite(
    StartWritingValues=toggle,
    DigitalPin13=0,
    DigitalPin12=0,
    DigitalPin11=0,
    DigitalPin10=c_script.A,
    DigitalPin9=c_script.B,
    DigitalPin8=0,
    DigitalPin6=0,
    DigitalPin5=0,
    DigitalPin3=0,
    PortNumber="9")  # -> ArduinoOutput, StatusMessage

# ----
panel_7 = Panel("""2
3""")
roatationb = Brep([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])
baseb = Brep([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])
item = ListItem(List=baseb, Index=panel_7, Wrap=True)
area = Area(Geometry=item)  # -> Area, Centroid
pline = PolyLine(Vertices=area.Centroid, Closed=False)
rotax = RotateAxis(Geometry=roatationb, Angle=expr("X-90", degrees(addition_3)), Axis=pline)  # -> Geometry, Transform
e_3scale = E3Scale(G=printingheadtcp)
panel_8 = Panel("""6
7
8""")
panel_9 = Panel("""2
3""")
item_2 = ListItem(List=rotax.Geometry, Index=panel_9, Wrap=True)
item_3 = ListItem(List=rotax.Geometry, Index=panel_8, Wrap=True)
cull_i = CullIndex(List=rotax.Geometry, Indices=panel_8, Wrap=True)
xy_4 = XYPlane(Origin=e_3scale)
area_2 = Area(Geometry=item_2)  # -> Area, Centroid
pt_4 = Point(Point(0, 0, 0))
pline_2 = PolyLine(Vertices=area_2.Centroid, Closed=False)
xy_5 = XYPlane(Origin=pt_4)
rotax_2 = RotateAxis(Geometry=item_3, Angle=expr("X-90", degrees(addition_2)), Axis=pline_2)  # -> Geometry, Transform
brep = Brep([baseb, cull_i, rotax_2.Geometry])
orient = Orient(Geometry=flatten(brep), Source=xy_5, Target=xy_4)  # -> Geometry, Transform
scale = Scale(G=orient.Geometry)
item_4 = ListItem(List=flatten(orient.Geometry), Index="8", Wrap=True)
preview = CustomPreview(Geometry=[orient.Geometry, scale], Material=ColourSwatch(SwatchColor=RGB(166, 166, 166)))
debrep = DeconstructBrep(Brep=item_4)  # -> Faces, Edges, Vertices
item_5 = ListItem(List=debrep.Faces, Index="5", Wrap=True)
cpoly = ControlPolygon(Curve=item_5)  # -> Polygon, Points
area_3 = Area(Geometry=item_5)  # -> Area, Centroid
item_6 = ListItem(List=cpoly.Points, Index=0, Wrap=True)  # -> Item, Item1, Item2, Item3
vec2pt = Vector2Pt(PointA=item_6.Item1, PointB=item_6.Item, Unitize=True)  # -> Vector, Length
vec2pt_2 = Vector2Pt(PointA=item_6.Item1, PointB=item_6.Item2, Unitize=True)  # -> Vector, Length
pl = ConstructPlane(Origin=area_3.Centroid, XAxis=vec2pt_2.Vector, YAxis=vec2pt.Vector)
rotatingbasepl = Plane(pl)

# ---- group: Shape and path generation
expression = Expression(x=printwidth_cm, Expression="x*6/7*10")
xy_6 = XYPlane(Origin=position_of_curvatureaxis)
# Geometry/Path Generation
scale_2 = Scale(G=rotatingbasepl)
deplane_2 = DeconstructPlane(Plane=scale_2)  # -> Origin, XAxis, YAxis, ZAxis
unit = UnitVector(Vector=deplane_2.ZAxis)
amp = Amplitude(Vector=unit, Amplitude=tcpdis_mm)
move = Move(Geometry=scale_2, Motion=amp)  # -> Geometry, Transform
multiplication = Multiplication(A=printendindex, B=fealayersperloop)
multiplication_2 = Multiplication(A=printstartindex, B=fealayersperloop)
printingtcppln = Plane(move.Geometry)
orient_2 = Orient(Geometry=curvature_axis, Source=xy_6, Target=printingtcppln)  # -> Geometry, Transform
divdist = DivideDistance(Curve=orient_2.Geometry, Distance=expr("X/1.6", expression))  # -> Points, Tangents, Parameters
lng = ListLength(List=divdist.Points)
pframes = PerpFrames(Curve=orient_2.Geometry, Count=lng, Align=True)  # -> flatten(Frames), Parameters
xy_7 = XYPlane(Origin=Point(0, 0, 0))
dom = ConstructDomain(DomainStart=multiplication_2, DomainEnd=expr("X-1", multiplication))
align = AlignPlanes(Planes=pframes.Frames, Master=xy_7)
lng_2 = ListLength(List=flatten(align))
division = Division(A=scale_of_shape, B=lng_2)
orient_3 = Orient(Geometry=geometrypattern, Source=PlaneXY(0, 0, 0), Target=graft(align))  # -> Geometry, Transform
series = Series(Start=1, Step=division, Count=lng_2)
scale_3 = Scale(Geometry=orient_3.Geometry, Center=graft(align), Factor=graft(series))  # -> Geometry, Transform
item_7 = ListItem(List=align, Index=0, Wrap=True)
crv = Curve(flatten(scale_3.Geometry))
subset = SubList(List=crv, Domain=dom, Wrap=True)  # -> flatten(List), Index
crv_2 = Curve(subset.List)
divdist_2 = DivideDistance(Curve=crv_2, Distance=expression)  # -> Points, Tangents, Parameters
deplane_3 = DeconstructPlane(Plane=item_7)  # -> Origin, XAxis, YAxis, ZAxis
subset_2 = SubList(List=align, Domain=dom, Wrap=True)  # -> simplify(graft(List)), Index
item_8 = ListItem(List=crv, Index=0, Wrap=True)
xy_8 = XYPlane(Origin=divdist_2.Points)  # -> simplify(Plane)
unit_2 = UnitVector(Vector=deplane_3.ZAxis)
deplane_4 = DeconstructPlane(Plane=subset_2.List)  # -> Origin, XAxis, YAxis, ZAxis
amp_2 = Amplitude(Vector=unit_2, Amplitude=expr("-X", tcpdis_mm))
move_2 = Move(Geometry=item_8, Motion=amp_2)  # -> Geometry, Transform
padjust = AdjustPlane(Plane=xy_8, Normal=deplane_4.ZAxis)
pln = Plane(padjust)
ins = InsertItems(List=crv, Item=move_2.Geometry, Indices="0", Wrap=True)

# ---- group: KUKA Prc simulation
# Printing Actions Preview (KUKAPrc)
kukasimulationpln = Plane(pln)
lin_move = LINearMovementKUKAPrc(TargetAsPlane=flatten(kukasimulationpln), extaxenabled=False, interpolation="C_DIS")
kr6_16_20 = KR616203Robot(infiniterot=False)
kuka_prc = KUKAPrcCORE(
    SimulationSlider=kuka_simulation_slider,
    KUKAPrcCommands=lin_move,
    Tool=custom_tool,
    Robot=kr6_16_20,
    PRC_BaseExpose=False,
    PRC_SaveNameExpose=False,
    PRCsettings="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")  # -> RobotGeometry, AnalysisOutput; disabled

# ---- group: StartPathPlaneDegree
xy_9 = XYPlane(Origin=Point(0, 0, 0))
align_2 = AlignPlanes(Planes=align, Master=xy_9)  # -> simplify(Planes)
item_9 = ListItem(List=align_2, Index=multiplication_2, Wrap=True)
Y = UnitY(Factor=1)
deplane_5 = DeconstructPlane(Plane=item_9)  # -> Origin, XAxis, YAxis, ZAxis
X = UnitX(Factor=1)
angle = Angle(VectorA=deplane_5.XAxis, VectorB=X)  # -> Angle, Reflex
angle_2 = Angle(VectorA=deplane_5.YAxis, VectorB=Y)  # -> Angle, Reflex
deg = Degrees(Radians=angle_2.Angle)
deg_2 = Degrees(Radians=angle.Angle)
int = Integer(flatten(deg))
int_2 = Integer(flatten(deg_2))
expression_2 = Expression(x=int, Expression="Format(\"StartPathDegreeB: {0}°\", x)")
expression_3 = Expression(x=int_2, Expression="Format(\"StartPathDegreeA: {0}°\", x)")

# ---- group: PathSetting (continued)
startpathdegreereference = Panel([expression_3, expression_2])

# ----
lng_3 = ListLength(List=crv)
division_2 = Division(A=lng_3, B=fealayersperloop)

shift = ShiftList(List=ins, Shift="-1", Wrap=False)
# Robotic Action Generation
item_10 = ListItem(List=pln, Index="-1", Wrap=True)
item_11 = ListItem(List=pln, Index="-2", Wrap=True)
subset_3 = SubList(List=shift, Domain=dom, Wrap=True)  # -> flatten(List), Index
vec2pt_3 = Vector2Pt(PointA=item_11, PointB=item_10, Unitize=False)  # -> Vector, Length
unit_3 = UnitVector(Vector=vec2pt_3.Vector)
amp_3 = Amplitude(Vector=unit_3, Amplitude="-1")
move_3 = Move(Geometry=item_10, Motion=amp_3)  # -> Geometry, Transform
ins_2 = InsertItems(List=pln, Item=move_3.Geometry, Indices="-2", Wrap=True)
graft = GraftTree(Tree=subset_3.List, IncludeEmptyLists=True, IncludeNullItems=True)
ins_3 = InsertItems(List=ins_2, Item=item_10, Indices="0", Wrap=True)
crv_cp = CurveClosestPoint(Point=ins_3, Curve=graft)  # -> Point, Parameter, Distance
dist = Distance(PointA=ins_3, PointB=crv_cp.Point)
transformto_2 = TransformTo(Plane=ins_3, Relative=False)
remap = RemapNumbers(Value=dist, Source=panel_3, Target=panel_4)  # -> Mapped, Clipped
int_3 = Integer(remap.Mapped)
speedto = SpeedTo(Speed=int_3, Relative=False)  # -> simplify(Action)

e_3scale_2 = E3Scale(G=position_of_curvatureaxis)
e_3scale_3 = E3Scale(G=curvature_axis)
xy_10 = XYPlane(Origin=e_3scale_2)
expression_4 = Expression(x=nozzlesize_mm, Expression="X/1000")
orient_4 = Orient(Geometry=e_3scale_3, Source=xy_10, Target=rotatingbasepl)  # -> Geometry, Transform
divdist_3 = DivideDistance(Curve=orient_4.Geometry, Distance=expr("X/1.6", expression_4))  # -> Points, Tangents, Parameters
lng_4 = ListLength(List=divdist_3.Points)
pframes_2 = PerpFrames(Curve=orient_4.Geometry, Count=lng_4, Align=True)  # -> flatten(Frames), Parameters
lng_5 = ListLength(List=flatten(pframes_2.Frames))
dom_2 = ConstructDomain(DomainStart=newpathstartindex, DomainEnd=printendindex)
e_3scale_4 = E3Scale(G=geometrypattern)
division_3 = Division(A=scale_of_shape, B=lng_5)
orient_5 = Orient(Geometry=e_3scale_4, Source=PlaneXY(0, 0, 0), Target=graft(pframes_2.Frames))  # -> Geometry, Transform
series_2 = Series(Start=1, Step=division_3, Count=lng_5)
scale_4 = Scale(Geometry=orient_5.Geometry, Center=graft(pframes_2.Frames), Factor=graft(series_2))  # -> Geometry, Transform
crv_3 = Curve(flatten(scale_4.Geometry))
partition = PartitionList(List=crv_3, Size=fealayersperloop)
item_12 = ListItem(List=partition, Index=0, Wrap=True)
tstat = TreeStatistics(Tree=partition)  # -> Paths, Length, Count
subset_4 = SubList(List=tstat.Paths, Domain=dom_2, Wrap=True)  # -> List, Index
branch = TreeBranch(Tree=item_12, Path=subset_4.List, MaintainPaths=True)
crv_4 = Curve(flatten(branch))

# ---- group: Define Elements
partition_2 = PartitionList(List=pframes_2.Frames, Size=fealayersperloop)
item_13 = ListItem(List=partition_2, Index=0, Wrap=True)
tstat_2 = TreeStatistics(Tree=partition_2)  # -> Paths, Length, Count
subset_5 = SubList(List=tstat_2.Paths, Domain=dom_2, Wrap=True)  # -> List, Index
branch_2 = TreeBranch(Tree=item_13, Path=subset_5.List, MaintainPaths=True)
item_14 = ListItem(List=flatten(branch_2), Index=0, Wrap=True)

# ----
maxendindex = Panel(division_2)
expression_5 = Expression(x=maxendindex, Expression="Format(\"{0:0}\",x)")
multiplication_3 = Multiplication(A=printendindex, B=expression_5)
dom_3 = ConstructDomain(DomainStart=multiplication_2, DomainEnd=expr("X-1", multiplication_3))
subset_6 = SubList(List=crv, Domain=dom_3, Wrap=True)  # -> flatten(List), Index
subset_7 = SubList(List=align, Domain=dom, Wrap=True)  # -> simplify(graft(List)), Index
crv_5 = Curve(subset_6.List)
deplane_6 = DeconstructPlane(Plane=subset_7.List)  # -> Origin, XAxis, YAxis, ZAxis
divdist_4 = DivideDistance(Curve=crv_5, Distance=expression)  # -> Points, Tangents, Parameters
xy_11 = XYPlane(Origin=divdist_4.Points)  # -> simplify(Plane)
padjust_2 = AdjustPlane(Plane=xy_11, Normal=deplane_6.ZAxis)
pln_2 = Plane(padjust_2)
shift_2 = ShiftList(List=ins, Shift="-1", Wrap=False)
item_15 = ListItem(List=pln_2, Index="-1", Wrap=True)
item_16 = ListItem(List=pln_2, Index="-2", Wrap=True)
subset_8 = SubList(List=shift_2, Domain=dom_3, Wrap=True)  # -> flatten(List), Index
vec2pt_4 = Vector2Pt(PointA=item_16, PointB=item_15, Unitize=False)  # -> Vector, Length
unit_4 = UnitVector(Vector=vec2pt_4.Vector)
amp_4 = Amplitude(Vector=unit_4, Amplitude="-1")
move_4 = Move(Geometry=item_15, Motion=amp_4)  # -> Geometry, Transform
ins_4 = InsertItems(List=pln_2, Item=move_4.Geometry, Indices="-2", Wrap=True)
graft_2 = GraftTree(Tree=subset_8.List, IncludeEmptyLists=True, IncludeNullItems=True)
ins_5 = InsertItems(List=ins_4, Item=item_15, Indices="0", Wrap=True)
crv_cp_2 = CurveClosestPoint(Point=ins_5, Curve=graft_2)  # -> Point, Parameter, Distance
dist_2 = Distance(PointA=ins_5, PointB=crv_cp_2.Point)
pt_5 = Point(ins_5)
ln = Line(StartPoint=pt_5, EndPoint=crv_cp_2.Point)
bnd = Bounds(Numbers=flatten(dist_2))
dedomain = DeconstructDomain(Domain=bnd)  # -> Start, End
printheightjudgment = CSharpScript(min=dedomain.Start, max=dedomain.End)  # -> out, A; inputs min: Double, max: Double
# ---------- printheightjudgment: C# ----------
    MIN = min;
    MAX = max;
    if(min >= 1.5 && max <= 6.0)
    {
      a = true;
    }
    else
    {
      a = false;
      this.Component.AddRuntimeMessage(GH_RuntimeMessageLevel.Warning, " Warning message.");

    }
    A = a;
# ---------- printheightjudgment: C# additional code ----------
  bool a;
  double MIN;
  double MAX;
# ---------- end printheightjudgment ----------

# ---- group: RealTimeRoboticActions
weave = Weave(Pattern=[0, 1], Stream0=speedto, Stream1=transformto_2, NullGaps=False)
xy_12 = XYPlane(Origin=finalactionspt)
writedigital = WriteDigital(DigitalPin="42", On=Toggle(False), ToolPin=False)
writedigital_2 = WriteDigital(DigitalPin="42", On=Toggle(True), ToolPin=False)
speedto_2 = SpeedTo(Speed=Slider(70, range=0..100), Relative=False)
transformto_3 = TransformTo(Plane=xy_12, Relative=False)
merge = Merge(Data1=speedto_2, Data2=transformto_3)  # -> flatten(Result)
precisionto = PrecisionTo(Radius="20", Relative=False)
ins_6 = InsertItems(List=weave, Item=writedigital_2, Indices="2", Wrap=True)  # -> simplify(List)
ins_7 = InsertItems(List=ins_6, Item=writedigital, Indices="-2", Wrap=True)  # -> simplify(List)
speedto_3 = SpeedTo(Speed=Slider(30, range=0..100), Relative=False)
ins_8 = InsertItems(List=ins_7, Item=precisionto, Indices="0", Wrap=True)  # -> simplify(List)
wait = Wait(Time=Slider(50, range=0..100))
ins_9 = InsertItems(List=ins_8, Item=wait, Indices="-1", Wrap=True)  # -> simplify(List)
merge_2 = Merge(Data1=flatten(ins_9), Data2=flatten(merge))  # -> flatten(Result)

# ---- group: RealTimeRoboticActions / nextlayer
merge_3 = Merge(Data1=flatten(speedto_3), Data2=flatten(merge_2))

# ---- group: Machina Bridge
machinaconnect = BooleanToggle(False)
merge_4 = Merge(Data1=flatten(definetool), Data2=flatten(attachtool))
connect = Connect(URL="ws://127.0.0.1:6999/Bridge", Name="GH", Connect=machinaconnect)  # -> Status, Bridge
action = Merge(Data1=flatten(merge_4), Data2=flatten(merge_3))  # -> flatten(Result)
listen = Listen(Bridge=connect.Bridge, Autoupdate=True, Interval=66)
send = Send(Bridge=connect.Bridge, Actions=action, Send=machinasend)  # -> Sent, Instructions

# ---- group: Render Text to Screen
multiplication_4 = Multiplication(A=newpathstartindex, B=fealayersperloop)
dom_4 = ConstructDomain(DomainStart=0, DomainEnd=multiplication_4)
subset_9 = SubList(List=crv, Domain=dom_4, Wrap=True)  # -> flatten(List), Index

# ----
loft = Loft(Curves=subset_9.List, Options={Adjust=False, Closed=False, LoftEnds=0, LoftSimp=0, LoftType=0, Rebuild=10, Refit=0.01})
oldpath = CustomPreview(Geometry=loft, Material=ColourSwatch(SwatchColor=RGB(204, 186, 186)))

# ---- group: CuringOldPath Calculation(True/False)
multiplication_5 = Multiplication(A=fealayersperloop, B=printendindex)
# Self-support function for Overhanging collapse
multiplication_6 = Multiplication(A=fealayersperloop, B=newpathstartindex)
dom_5 = ConstructDomain(DomainStart="0", DomainEnd=expr("x-1", multiplication_5))
dom_6 = ConstructDomain(DomainStart="0", DomainEnd=expr("x-1", multiplication_6))

# ---- group: Define Materials
# FEA Solving (Karamba3D) for Global deformation
subset_10 = SubList(List=crv_4, Domain=dom_2, Wrap=True)  # -> List, Index
len = Length(Curve=subset_10.List)  # -> flatten(Length)
printspeed_mm_min = Slider(540, range=0..20000)
sortc = SortCurvesAlongCrv(Curves=subset_10.List, GuideCrv=e_3scale_3, CrvParam=0.5)  # -> SortedCurves, CurveIndex
panel_10 = Panel("3DCP")
panel_11 = Panel("paperClay")

# ---- group: Mesh Geometry
shift_3 = ShiftList(List=sortc.SortedCurves, Shift=-1, Wrap=False)  # -> graft(List)
shift_4 = ShiftList(List=sortc.SortedCurves, Shift=1, Wrap=False)  # -> graft(List)
len_2 = Length(Curve=shift_4)
merge_5 = Merge(Data1=shift_3, Data2=shift_4)
division_4 = Division(A=len_2, B=expression_4)
loft_2 = Loft(Curves=merge_5, Options={Adjust=False, Closed=False, LoftEnds=0, LoftSimp=0, LoftType=0, Rebuild=10, Refit=0.01})  # -> flatten(Loft)
int_4 = Integer(simplify(division_4))
debrep_2 = DeconstructBrep(Brep=loft_2)  # -> simplify(Faces), Edges, Vertices
mesh_uv = MeshSurface(Surface=debrep_2.Faces, UCount=Slider(1, range=0..1), VCount=int_4, Overhang=True, Equalize=False)  # -> graft(Mesh)

# ---- group: Inclination calculation(atmospheric pressure force)
crv_6 = Curve(crv_3)
multiplication_7 = Multiplication(A=printendindex, B=fealayersperloop)
avr = Average(Input=flatten(int_3))
dom_7 = ConstructDomain(DomainStart=0, DomainEnd=expr("X-1", multiplication_7))
item_17 = ListItem(List=crv_6, Index=0, Wrap=True)
int_5 = Integer(avr)
subset_11 = SubList(List=crv_6, Domain=dom_7, Wrap=True)  # -> List, Index
len_3 = Length(Curve=item_17)
len_4 = Length(Curve=subset_11.List)
subtraction = Subtraction(A=addition_3, B="90")
ma = MassAddition(Input=len_4)  # -> Result, PartialResults
abs = Absolute(Value=subtraction)
expression_6 = Expression(x=ma.Result, y=int_5, z=panel_2, Expression="x*1000/(y*0.3)*z")
cos = Cosine(Value=degrees(abs))

# ---- group: CuringOldPath Calculation(True/False) (continued)
subset_12 = SubList(List=crv_6, Domain=dom_5, Wrap=True)  # -> List, Index
subset_13 = SubList(List=crv_6, Domain=dom_6, Wrap=True)  # -> List, Index
len_5 = Length(Curve=subset_12.List)
len_6 = Length(Curve=subset_13.List)
ma_2 = MassAddition(Input=len_5)  # -> Result, PartialResults
ma_3 = MassAddition(Input=len_6)  # -> Result, PartialResults
expression_7 = Expression(x=ma_2.Result, Expression="x*1000/9")
multiplication_8 = Multiplication(A=expression_7, B=curingspeed_mm_s)
expression_8 = Expression(x=ma_3.Result, Expression="x*1000")
smaller = SmallerThan(FirstNumber=expression_8, SecondNumber=multiplication_8)  # -> SmallerThan, OrEqualTo

# ---- group: Inclination calculation(atmospheric pressure force) / areaA (mm2)
expression_9 = Expression(x=len_3, y=printwidth_cm, Expression="x*1000*(y*5/7)*10")

# ---- group: Inclination calculation(atmospheric pressure force) / SecurityFactor
remap_2 = RemapNumbers(Value=abs, Source="25 to 75", Target="0.029 to 0.021")  # -> Mapped, Clipped

# ---- group: Define Materials / Aging
shift_5 = ShiftList(List=len, Shift=1, Wrap=False)
lng_6 = ListLength(List=shift_5)

# ---- group: Define Materials / Material Naming
python = GhPythonScript(name="Shell_", length=lng_6)  # -> out, graft(myName)
# ---------- python: Python ----------
__author__ = "WUD"
__version__ = "2019.10.23"

import rhinoscriptsyntax as rs

finalName=[]
for i in range(length):
    currentName = name+str(i)
    print currentName
    finalName.append(currentName)
    
myName = finalName
# ---------- end python ----------

# ---- group: Define Elements
pln_3 = Plane(item_14)
deplane_7 = DeconstructPlane(Plane=pln_3)  # -> Origin, XAxis, YAxis, ZAxis
unit_5 = UnitVector(Vector=deplane_7.ZAxis)
amp_5 = Amplitude(Vector=unit_5, Amplitude="0.002")
move_5 = Move(Geometry=pln_3, Motion=amp_5)  # -> Geometry, Transform
pt_6 = ConstructPoint(XCoordinate=0, YCoordinate=0, ZCoordinate=0)

# ---- group: Define Materials (continued)
multiplication_9 = Multiplication(A=shift_5, B=Slider(1000, range=0..1000))

# ---- group: Define Materials / Aging / aging in min
division_5 = Division(A=multiplication_9, B=printspeed_mm_min)

# ---- group: Define Materials / Aging (continued)
python_2 = GhPythonScript(mins=division_5)  # -> out, aging; inputs mins: list
# ---------- python_2: Python ----------
__author__ = "WUD"
__version__ = "2019.11.12"

import rhinoscriptsyntax as rs

finalAging= []
for min in mins:
    if len(finalAging) == 0:
        finalAging.append(min)
    else:
        for i in range(len(finalAging)):
            finalAging[i] += min
        finalAging.append(min)
aging = finalAging
# ---------- end python_2 ----------

# ---- group: Inclination calculation(atmospheric pressure force) (continued)
P = Expression(x=expression_6, y=cos, z=expression_9, Expression="x/1000*9.8*y/(z/1000000)")

# ---- group: Inclination calculation(atmospheric pressure force) / W
expression_10 = Expression(x=P, y=expression_9, f=remap_2.Mapped, Expression="(101325-x)/101325*(y/100)*f")

# ---- group: Inclination calculation(atmospheric pressure force) (continued)
larger = LargerThan(FirstNumber=expression_10, SecondNumber=expr("X/1000", expression_6))  # -> LargerThan, OrEqualTo

# ---- group: Define Materials (continued)
eval = Evaluate(F="0.00015 + 0.000014*t + testValue", t=python_2.aging, testValue=curingparameters)  # -> graft(r)
eval_2 = Evaluate(F="0.002 + 0.000013*t + testValue", t=python_2.aging, testValue=curingparameters)  # -> graft(r)

# ---- group: Define Materials / Shear Module
division_6 = Division(A=eval_2, B="2.6")  # -> graft(Result)

# ---- group: Define Materials (continued)
matprops = MaterialPropertiesKaramba3D(
    FamilyOfMaterial=panel_11,
    Name=panel_10,
    ElementIdentifier=python.myName,
    YoungsModulus_kN_cm2=eval_2,
    InPlaneShearModulus_kN_cm2=division_6,
    TransverseShearModulus_kN_cm2=division_6,
    SpecificWeight_kN_m3=number_slider,
    CoefficientOfThermalExpansion_1_C=number_slider_2,
    TensileStrength_kN_cm2=eval,
    CompressiveStrength_kN_cm2=-23.5,
    StrengthHypothesis="MISES",
    mode="Isotrop")  # -> graft(Material)

# ---- group: Define Cross Sections
cross_section_2 = CrossSectionKaramba3D(
    FamilyNameOfCrossSection=panel_11,
    NameOfCrossSection=panel_10,
    ElementIdentifier=python.myName,
    Material=simplify(matprops),
    Height_cm=printwidth_cm,
    mode="Shell - Const")  # -> simplify(CrossSection)

# ---- group: Define Elements
mesh_2 = Mesh(mesh_uv)
meshtoshell = MeshToShellKaramba3D(Mesh=simplify(mesh_2), Identifier=simplify(python.myName), CrossSection=cross_section_2, LimitDistance_m=0.005)  # -> flatten(Element), Points, Info

pt_7 = Point(flatten(meshtoshell.Points))
cullpt = CullDuplicates(Points=pt_7, Tolerance="0.001", CullMode=3)  # -> Points, Indices, Valence
plntrimpts = PlaneTrimPoints(Points=flatten(cullpt.Points), Plane=move_5.Geometry, Flip=True)  # -> Trimmed, KeptIndicies, Intersected
basesupportpts = Point(flatten(plntrimpts.Trimmed))
shift_6 = ShiftList(List=basesupportpts, Shift=1, Wrap=True)
merge_6 = Merge(Data1=shift_6, Data2=basesupportpts)
ln_2 = Line(StartPoint=shift_6, EndPoint=basesupportpts)
linetobeam = LineToBeamKaramba3D(
    Line=ln_2,
    Identifier=panel_5,
    CrossSection=cross_section,
    Points=merge_6,
    New=True,
    Remove=True,
    LimitDistance_m=0.005,
    Bending=True,
    SetBucklingLength=True,
    ToPolylineMaxAngle=0.03,
    ToPolylineTolerance=0.01,
    ToPolylineMinEdgeLength=0.25)  # -> Element, Points, Info
vec2pt_5 = Vector2Pt(PointA=pt_6, PointB=basesupportpts, Unitize=False)  # -> Vector, Length
orientate = OrientateElemKaramba3D(Beam=linetobeam.Element, XOrientation=vec2pt_5.Vector, mode="Beam")

# ---- group: Define Supports
lng_7 = ListLength(List=basesupportpts)
panel_12 = Panel(lng_7)
series_3 = Series(Start=panel_12, Step=1, Count=panel_12)
supp = SupportKaramba3D(PosInd=series_3, menu=[buttons(on, on, on, on, on, on)])

# ---- group: Assemble Model
assemble = AssembleModelKaramba3D(
    Point=flatten(linetobeam.Points),
    Elem=flatten([meshtoshell.Element, orientate]),
    Support=flatten(supp),
    Load=flatten(loads),
    CrossSection=flatten([cross_section_2, cross_section]),
    Material=flatten(matprops),
    LimitDistance_m=0.005)  # -> Model, Info, Mass_kg, CenterOfGravity, LoadCaseNames

# ---- group: Analyze Model
analyzethii = AnalyzeThIIKaramba3D(
    Model=assemble.Model,
    RTolerance=Slider(0.0001, range=0..1),
    MaxIterations=Slider(100, range=0..100),
    NoTensionalNII=Toggle(True))  # -> CalculatedModel, MaximumDisplacement_cm, ResultingForceOfGravity_kN, ElasticEnergy_kNm
modelview = ModelViewKaramba3D(Model=analyzethii.CalculatedModel, ResultFactors=1, ResultCase=-1)  # -> Model, DeformedMesh, DeformedAxes, DeformedModel
displacement = Panel(analyzethii.MaximumDisplacement_cm)
xy_13 = XYPlane(Origin=Point(0, 0, 0))
shellview = ShellViewKaramba3D(Model=modelview.Model, IndexOfLayer=0)  # -> Model, MeshesOfRenderedShells, LegendColors, LegendTags
mjoin_2 = MeshJoin(Meshes=shellview.MeshesOfRenderedShells)
geo_2 = Geometry(mjoin_2)
pt_8 = Point(xy_13)
scale_5 = Scale(Geometry=geo_2, Center=pt_8, Factor=Slider(1000, range=0..1000))  # -> Geometry, Transform
legend = Legend(Colour=shellview.LegendColors, Tags=shellview.LegendTags, LegendType=1)

# ----
efamesh = Geometry(scale_5.Geometry)

# ---- group: Render Text to Screen
# Simulation Output
expression_11 = Expression(x=printstartindex, y=fealayersperloop, Expression="x*y")
expression_12 = Expression(x=addition_3, y=addition_2, Expression="Format(\"Rotation DegreeA: {0}°  DegreeB: {1}°\", -(x-90), y-90)")
expression_13 = Expression(x=printstartindex, y=fealayersperloop, Expression="x*y+1")
expression_14 = Expression(x=printendindex, y=fealayersperloop, Expression="x*y")
multiplication_10 = Multiplication(A=analyzethii.MaximumDisplacement_cm, B=10)
expression_15 = Expression(x=expression_11, Expression="Format(\"Printed Layers   : {0}L\", x)")
expression_16 = Expression(x="Will Print Layers: ", y=expression_13, z=expression_14, Expression="Format(\"{0}{1}L to {2}L\", x, y, z)")
expression_17 = Expression(Expression="NewPathStartInedx Setting has error!!!")  # -> flatten(R)
panel_13 = Panel("""Print Heights are out of 1.5mm to 6mm!!!
Please change the geometry shape.""")
expression_18 = Expression(x=expression_4, Expression="X*1000*0.5")
panel_14 = Panel("")
number_slider_3 = Slider(20, range=0..100)
swatch = ColourSwatch(SwatchColor=RGB(255, 3, 3))
filter = StreamFilter(Gate=smaller.SmallerThan, Stream0=expression_17, Stream1=panel_14)
filter_2 = StreamFilter(Gate=larger.LargerThan, Stream0="The inclination of Additional-axis base is too large!!!", Stream1=panel_14)
filter_3 = StreamFilter(Gate=printheightjudgment.A, Stream0=panel_13, Stream1=panel_14)
printingpath = Curve(subset.List)
geometrypath = Curve(crv)

# ----
multiplication_11 = Multiplication(A=multiplication_10, B="2")

# ---- group: Render Text to Screen (continued)
expression_19 = Expression(x="MaximumDisplacement: ", y=multiplication_11, z="mm", Expression="Format(\"{0}{1:0.000} {2}\", x, y, z)")
merge_7 = Merge(Data1=flatten(expression_15), Data2=flatten(expression_16), Data3=flatten(expression_12), Data4=flatten(expression_19))
lng_8 = ListLength(List=merge_7)
smaller_2 = SmallerThan(FirstNumber=multiplication_11, SecondNumber=expression_18)  # -> SmallerThan, OrEqualTo
series_4 = Series(Start="100", Step="30", Count=lng_8)
item_18 = ListItem(List=series_4, Index="-1", Wrap=True)
addition_4 = Addition(A=item_18, B="30")
addition_5 = Addition(A=addition_4, B="30")
c_script_2 = CSharpScript(x=smaller_2.SmallerThan, y=larger.LargerThan, z=smaller.SmallerThan, u=printheightjudgment.A)  # -> out, A; inputs x: Boolean, y: Boolean, z: Boolean, u: Boolean
# ---------- c_script_2: C# ----------
    if(x == true && y == true && z == true && u == true)
    {
      a = 1;
    }
    else
    {
      a = 0;
    }
    A = a;
# ---------- c_script_2: C# additional code ----------
  int a;
# ---------- end c_script_2 ----------
pt_9 = ConstructPoint(XCoordinate="100", YCoordinate=addition_4, ZCoordinate=0)
pt_10 = ConstructPoint(XCoordinate="100", YCoordinate=series_4, ZCoordinate=0)
filter_4 = StreamFilter(Gate=c_script_2.A, Stream0=swatch, Stream1=ColourSwatch(SwatchColor=RGB(4, 133, 23)))
filter_5 = StreamFilter(Gate=c_script_2.A, Stream0="Wanning! Printing path has errors:", Stream1="Can Be Printed Beautifully.")
texttoscreen = RenderTextToScreen(Text=merge_7, Location=pt_10, Size=number_slider_3, Color=RGB(0, 0, 0), m_scWithvp=False)
texttoscreen_2 = RenderTextToScreen(Text=filter_5, Location=pt_9, Size=number_slider_3, Color=filter_4, m_scWithvp=False)

# ----
filter_6 = StreamFilter(Gate=smaller_2.SmallerThan, Stream0="The deformation value exceeds the set limit (6mm)", Stream1=panel_14)

# ---- group: Render Text to Screen (continued)
len_7 = TextLength(Text=[filter_2, filter, filter_3, filter_6])
equals = Equality(FirstNumber=len_7, SecondNumber=0)  # -> Equality, Inequality
cull = CullPattern(List=[filter_2, filter, filter_3, filter_6], CullPattern=equals.Inequality)
lng_9 = ListLength(List=cull)
series_5 = Series(Start=addition_5, Step="30", Count=lng_9)
pt_11 = ConstructPoint(XCoordinate="100", YCoordinate=series_5, ZCoordinate=0)
texttoscreen_3 = RenderTextToScreen(Text=cull, Location=pt_11, Size=number_slider_3, Color=swatch, m_scWithvp=False)

# ==== cluster Scale
xy = XYPlane(Origin=Point(0, 0, 0))
G = ClusterInput()
pt = Point(xy)
scale = Scale(Geometry=G, Center=pt, Factor=Slider(1000, range=0..1000))  # -> Geometry, Transform
G_2 = ClusterOutput(scale.Geometry)

# ==== cluster E3Scale
G = ClusterInput()
scale = Scale(Geometry=G, Center=Point(0, 0, 0), Factor="0.001")  # -> Geometry, Transform
G_2 = ClusterOutput(scale.Geometry)
